vi "Poll_tracker.gvi"   [LabVIEW NXG 2.0.0]
inputs:
  "VISA resource name": "Instr" = "ASRL3::INSTR"
  "error in (no error)": error
outputs:
  "Port data status": i32
  "VISA resource name out": "Instr"
  "Binary mode status": string
  "Coordinate mode status": string
  "Matrix mode status": string
  "FPS status": i32
  "error out": error
  "read buffer": string
panel indicators:
  "Serial Settings:Number of Bytes at Serial Port": u32
  "token index": i32
  "Array of tokens": string[]
  "Binary mode index": i32
  "Coordinate mode index": i32
  "Matrix mode index": i32
  "FPS target index": i32
  "Poll records": u32
  "Port data status index": i32
uses:
  NI::VISA::Write (Instr, String).gvi
  NI::VISA::Read (Instr, String).gvi
diagram:
  Concatenate Strings("P", "\r") -> w1
  call "Write (Instr, String).gvi"(session in=$"VISA resource name", error in=$"error in (no error)", write buffer=w1) -> (session out=w2, error out=w3, return count=w4)
  sequence {
    frame 0 {
      Wait(time to wait=100)
    }
  }
  Property Node(instance in=w2, error in=w3) -> ("ASRL Bytes at Port"=w5, error out=w6, instance out=w7)
  call "Read (Instr, String).gvi"(session in=w7, error in=w6, byte count=w5) -> (session out=w8, error out=w9, read buffer=w10)
  while {
    w12 = ["I am alive", "Binary mode", "Coordinate mode", "Matrix mode", "FPS target", "External USART status", "LED status", "Port data status", "IOS"]
    Feedback Node(initial value=0, input=w13) -> w14
    Scan String For Tokens(allow empty tokens=FALSE, delimiters=["\\r", "\\n", "\\s", "\\r\\n", ",", ":", " ", "="], input string=w10, offset=w14, operators=w12, use cache=FALSE) -> (offset past token=w13, token index=w15, token string=w16)
    Is Equal(x=w15, y=-2) -> w17
    $"token index" <- w15
    append w16 to w11
    stop if w17
  }
  Search 1D Array(1D array=w11, element="Port data status") -> (index of element=w18)
  $"Port data status index" <- w18
  Search 1D Array(1D array=w11, element="Matrix mode") -> (index of element=w19)
  $"Matrix mode index" <- w19
  $"VISA resource name out" <- w8
  Increment(x=w18) -> w20
  Array Index(array=w11) -> (out0[w20]=w21)
  String Length(string=w21) -> (length=w22)
  Subtract(x=w22, y=2) -> w23
  String Subset(length (rest)=w23, offset (0)=0, string=w21) -> w24
  Decimal String To Number(string=w24) -> (number=w25)
  $"Port data status" <- w25
  Search 1D Array(1D array=w11, element="Binary mode") -> (index of element=w26)
  $"Binary mode index" <- w26
  $"Poll records" <- w4
  $"read buffer" <- w10
  Add(w19, 1) -> w27
  Array Index(array=w11) -> (out0[w27]=w28)
  String Length(string=w28) -> (length=w29)
  Subtract(x=w29, y=2) -> w30
  String Subset(length (rest)=w30, offset (0)=0, string=w28) -> w31
  $"Matrix mode status" <- w31
  $"Array of tokens" <- w11
  $"Serial Settings:Number of Bytes at Serial Port" <- w5
  Search 1D Array(1D array=w11, element="FPS target") -> (index of element=w32)
  $"FPS target index" <- w32
  Add(w26, 1) -> w33
  Array Index(array=w11) -> (out0[w33]=w34)
  String Length(string=w34) -> (length=w35)
  Subtract(x=w35, y=2) -> w36
  String Subset(length (rest)=w36, offset (0)=0, string=w34) -> w37
  $"Binary mode status" <- w37
  Add(w32, 1) -> w38
  Array Index(array=w11) -> (out0[w38]=w39)
  String Length(string=w39) -> (length=w40)
  Subtract(x=w40, y=2) -> w41
  String Subset(length (rest)=w41, offset (0)=0, string=w39) -> w42
  Decimal String To Number(string=w42) -> (number=w43)
  $"FPS status" <- w43
  Search 1D Array(1D array=w11, element="Coordinate mode") -> (index of element=w44)
  $"Coordinate mode index" <- w44
  Add(w44, 1) -> w45
  Array Index(array=w11) -> (out0[w45]=w46)
  String Length(string=w46) -> (length=w47)
  Subtract(x=w47, y=2) -> w48
  String Subset(length (rest)=w48, offset (0)=0, string=w46) -> w49
  $"Coordinate mode status" <- w49
  w50 = error {"status"=TRUE, "code"=404, "source"="Instrument is not connected!"}
  String Length(string=w10) -> (length=w51)
  Is Greater Than 0(x=w51) -> w52
  Select(s=w52, t=w9, f=w50) -> w53
  $"error out" <- w53
